# Grasshopper definition Noise.gh (Grasshopper 1.0.7)
# plug-ins: NoiseWrapper, Noise 4D, LunchBox

# ---- group: 2D
number_slider = Slider(1.9, range=0..10)
number_slider_2 = Slider(100, range=0..100)
number_slider_3 = Slider(100, range=0..100)
python = GhPythonScript(N=number_slider_2, Y=number_slider_3)  # -> points; inputs N: Int32
# ---------- python: Python ----------
import scriptcontext as sc
import Rhino.Geometry as rg
import Rhino.RhinoMath as rmath
import random as rnd
                

points = []
for i in range(N):
    point = rg.Point3d(i,rnd.random()*Y,0)
    points.append(point)

#line = rg.Line(sc.sticky['start_pt'],sc.sticky['dir_vec'],Len)
#line=rg.Circle(sc.sticky['start_pt'],sc.sticky['step_pt'],sc.sticky['Circle_pt'])
# ---------- end python ----------
python_2 = GhPythonScript(N=number_slider_2, Y=number_slider_3)  # -> points; inputs N: Int32; same code as python
python_3 = GhPythonScript(N=number_slider_2, Y=number_slider_3)  # -> points; inputs N: Int32; same code as python
python_4 = GhPythonScript(N=number_slider_2, Y=number_slider_3)  # -> points; inputs N: Int32; same code as python
python_5 = GhPythonScript(N=number_slider_2, Y=number_slider_3)  # -> points; inputs N: Int32; same code as python
python_6 = GhPythonScript(N=number_slider_2, Y=number_slider_3)  # -> points; inputs N: Int32; same code as python
polygon = Polygon(Plane=python, Radius=number_slider, Segments="4", FilletRadius=0)  # -> Polygon, Length
polygon_2 = Polygon(Plane=python_2, Radius=number_slider, Segments="3", FilletRadius=0)  # -> Polygon, Length
polygon_3 = Polygon(Plane=python_3, Radius=number_slider, Segments="7", FilletRadius=0)  # -> Polygon, Length
polygon_4 = Polygon(Plane=python_4, Radius=number_slider, Segments="5", FilletRadius=0)  # -> Polygon, Length
polygon_5 = Polygon(Plane=python_5, Radius=number_slider, Segments="6", FilletRadius=0)  # -> Polygon, Length
cir = Circle(Plane=python_6, Radius=number_slider)
boundary = BoundarySurfaces(Edges=polygon.Polygon)
boundary_2 = BoundarySurfaces(Edges=polygon_2.Polygon)
boundary_3 = BoundarySurfaces(Edges=polygon_3.Polygon)
boundary_4 = BoundarySurfaces(Edges=polygon_4.Polygon)
boundary_5 = BoundarySurfaces(Edges=polygon_5.Polygon)
boundary_6 = BoundarySurfaces(Edges=cir)
preview = CustomPreview(Geometry=boundary, Material=ColourSwatch(SwatchColor=RGB(217, 235, 0)))
preview_2 = CustomPreview(Geometry=boundary_2, Material=ColourSwatch(SwatchColor=RGB(226, 26, 91)))
preview_3 = CustomPreview(Geometry=boundary_3, Material=ColourSwatch(SwatchColor=RGB(54, 217, 132)))
preview_4 = CustomPreview(Geometry=boundary_4, Material=ColourSwatch(SwatchColor=RGB(29, 50, 255)))
preview_5 = CustomPreview(Geometry=boundary_5, Material=ColourSwatch(SwatchColor=RGB(0, 166, 55)))
preview_6 = CustomPreview(Geometry=boundary_6, Material=ColourSwatch(SwatchColor=RGB(110, 110, 253)))

# ---- group: animate
number_slider_4 = Slider(96, range=0..100)
torus = TorusSurface(
    UDivisions=90,
    VDivisions=96,
    CParameter=4,
    RParameter=2,
    TParameter=1,
    Scale=Slider(15, range=0..100),
    Domain1=Domain(0, 6.283185307),
    Domain2=Domain(-3.141592654, 3.141592654))
python_7 = GhPythonScript(STATE=Toggle(True), step=Slider(0.098, range=0..0.1))  # -> time
# ---------- python_7: Python ----------
import scriptcontext as sc

if not STATE:
    sc.sticky['time']=0
else:
    sc.sticky['time']+=step
time=sc.sticky['time']
# ---------- end python_7 ----------
mesh_uv = MeshSurface(Surface=torus, UCount=number_slider_4, VCount=number_slider_4, Overhang=True, Equalize=False)
demesh = DeconstructMesh(Mesh=mesh_uv)  # -> Vertices, Faces, Colours, Normals
simplex = SimplexNoise(Values=demesh.Vertices, Time=python_7, Scale=Slider(0.02, range=0..1))
multiplication = Multiplication(A=demesh.Normals, B=simplex)
multiplication_2 = Multiplication(A=multiplication, B=Slider(13, range=0..100))
move = Move(Geometry=demesh.Vertices, Motion=multiplication_2)  # -> Geometry, Transform
conmesh = ConstructMesh(Vertices=move.Geometry, Faces=demesh.Faces)
demesh_2 = DeconstructMesh(Mesh=conmesh)  # -> Vertices, Faces, Colours, Normals
col = Colour(demesh_2.Normals)
conmesh_2 = ConstructMesh(Vertices=demesh_2.Vertices, Faces=demesh_2.Faces, Colours=col)

# ---- group: 3D
nw = NoiseWrapper(Reset=False, Seed=209323094, Length=10, Width=Slider(11, range=0..100), Scale=0.1000000015)  # -> TextValues, Noise1D, Noise2D
number_slider_5 = Slider(61, range=0..100)
python_8 = GhPythonScript(Noise=nw.Noise2D, N=Slider(7, range=0..100), Step=Slider(13, range=0..100))  # -> points; inputs Noise: list, N: Int32, Step: Int32
# ---------- python_8: Python ----------
import Rhino.Geometry as rg
import random as rnd

rnd.seed(100)
points = []
k=0
for i in range (N):
    for j in range (N):
        point = rg.Point3d(i*Step,j*Step,Noise[k])
        points.append(point)
        k+=2
# ---------- end python_8 ----------
msphere = MeshSphere(Base=python_8, Radius=Slider(24, range=0..100), UCount=number_slider_5, VCount=number_slider_5)
demesh_3 = DeconstructMesh(Mesh=msphere)  # -> Vertices, Faces, Colours, Normals
col_2 = Colour(demesh_3.Normals)
conmesh_3 = ConstructMesh(Vertices=demesh_3.Vertices, Faces=demesh_3.Faces, Colours=col_2)

# ----
trigger = Trigger(Interval=10, TimerInterval=10, Target=python_7)  # disabled
